% Simulink data dictionary data.sldd

servoPins = struct(
  aileron=struct(left=9, right=10),
  elevator=struct(left=7, right=8),
  rudder=11,
  flap=struct(left=5, right=6))

envConsts = struct(magVar=-1.3, refHeight=0)

Uplink = Simulink.Bus()
  AutoflightRefValues: Bus: AutoflightDemandedValues
  Override: boolean
  ControlOverride: Bus: ControlOverrides

Demands = Simulink.Bus()
  FlightMode: Bus: FlightMode
  Altitude: single, Unit="m"
  Heading: single, Unit="deg"
  Override: boolean
  ControlOverrides: Bus: ControlOverrides

AutoflightDemandedValues = Simulink.Bus()
  FlightMode: Bus: FlightMode
  HoldAltitude: single, Unit="m"
  HoldHeading: single, Unit="deg"

ControlOverrides = Simulink.Bus()
  Aileron: single
  Elevator: single
  Flap: single
  Throttle: single
  Rudder: single

Commands = Simulink.Bus()
  Aileron: single, Unit="deg"
  Elevator: single, Unit="deg"
  Flap: single, Unit="deg"
  Throttle: single
  Rudder: single, Unit="deg"

actuatorCentres = struct(
  aileron=struct(left=single(0), right=single(0)),
  elevator=struct(right=single(0), left=single(0)),
  flap=struct(left=single(0), right=single(0)),
  rudder=single(0))

deflectionLimits = struct(
  aileron=struct(min=single(-10), max=single(10)),
  elevator=struct(max=single(10), min=single(-10)),
  flap=struct(max=single(15), min=single(0)),
  rudder=struct(min=single(-5), max=single(5)))

sensorSampleTime = Simulink.Parameter(0.02)
loggingSampleTime = Simulink.Parameter(1)
SecArd = 0

sensorSystemMatrix = [1 0 0 0.02 0 0 0.0002 0 0 0 0 0 0 0 0
 0 1 0 0 0.02 0 0 0.0002 0 0 0 0 0 0 0
 0 0 1 0 0 0.02 0 0 0.0002 0 0 0 0 0 0
 0 0 0 1 0 0 0.02 0 0 0 0 0 0 0 0
 0 0 0 0 1 0 0 0.02 0 0 0 0 0 0 0
 0 0 0 0 0 1 0 0 0.02 0 0 0 0 0 0
 0 0 0 0 0 0 1 0 0 0 0 0 0 0 0
 0 0 0 0 0 0 0 1 0 0 0 0 0 0 0
 0 0 0 0 0 0 0 0 1 0 0 0 0 0 0
 0 0 0 0 0 0 0 0 0 1 0 0 0.02 0 0
 0 0 0 0 0 0 0 0 0 0 1 0 0 0.02 0
 0 0 0 0 0 0 0 0 0 0 0 1 0 0 0.02
 0 0 0 0 0 0 0 0 0 0 0 0 1 0 0
 0 0 0 0 0 0 0 0 0 0 0 0 0 1 0
 0 0 0 0 0 0 0 0 0 0 0 0 0 0 1]

sensorControlMatrix = [0 0 0
 0 0 0
 0 0 0
 0 0 0
 0 0 0
 0 0 0
 1 0 0
 0 1 0
 0 0 1
 0 0 0
 0 0 0
 0 0 0
 0 0 0
 0 0 0
 0 0 0]

FlightMode = Simulink.Bus()
  AltHold: single
  HdgHold: single

Sensors = Simulink.Bus()
  X_e: single[3], Unit="m"
  V_e: single[3], Unit="m/s"
  phi_theta_psi: single[3], Unit="rad"
  pqr: single[3], Unit="rad/s"

States = Simulink.Bus()
  phi_theta_psi: double[3], Unit="rad"
  pqr: double[3], Unit="rad/s"
  omega_dot: double[3], Unit="rad/s^2"
  X_e: double[3], Unit="m"
  V_b: double[3], Unit="m/s"
  A_be: double[3], Unit="m/s^2"
  V_e: double[3], Unit="m/s"

ActuatorStates = Simulink.Bus()
  Aileron: double, Unit="deg"
  Elevator: double, Unit="deg"
  Rudder: double, Unit="deg"
  Flap: double, Unit="deg"

SimType = 0

vehicle = struct(
  mass=1.23,
  inertia=[0.06571 -0.0002 0.00321; -0.0002 0.11643 -6.0e-5; 0.00321 -6.0e-5 0.17656],
  wingspan=1.8,
  wingarea=0.1654,
  aclength=1.257,
  CG=[0.3789 0 0.0381],
  CP=[0.01 0 -0.001],
  stallSpeed=7.5,
  thrust=7.5619,
  cbar=0.1862)

initConditions = struct(x0=[0 0 50], v0=[15 0 0], euler0=[0 0 0], w0=[0 0 0])

datcomorig = {struct(
  case="FLAPS: UAV",
  mach=0.05,
  alt=100,
  alpha=[-14 -12 -10 -8 -6 -5 -4 -2 -1 0 1 2 4 5 8 10 12 14 16 18],
  nmach=1,
  nalt=1,
  nalpha=20,
  rnnub=[],
  hypers=false,
  loop=1,
  sref=3.561,
  cbar=0.613,
  blref=5.91,
  dim="ft",
  deriv="deg",
  stmach=0.6,
  tsmach=1.4,
  save=false,
  stype=[],
  trim=false,
  damp=true,
  build=1,
  part=false,
  highsym=true,
  highasy=false,
  highcon=false,
  tjet=false,
  hypeff=false,
  lb=false,
  pwr=false,
  grnd=false,
  wsspn=2.6575,
  hsspn=1,
  ndelta=5,
  delta=[0 5 10 15 20],
  deltal=[],
  deltar=[],
  ngh=0,
  grndht=[],
  config=struct(downwash=false, body=true, wing=true, htail=false, vtail=false, vfin=false),
  version=1976,
  cd=[0.069; 0.053; 0.039; 0.029; 0.022; 0.02; 0.019; 0.018; 0.019; 0.02; 0.022; 0.025; 0.034; 0.039; 0.061; 0.08; 0.097; 0.112; 0.123; 0.126],
  cl=[-1.07; -0.878; -0.686; -0.497; -0.312; -0.222; -0.133; 0.039; 0.126; 0.215; 0.306; 0.399; 0.589; 0.686; 0.982; 1.179; 1.329; 1.45; 1.535; 1.554],
  cm=[-0.1201; -0.1053; -0.0913; -0.0781; -0.0657; -0.0598; -0.0541; -0.0435; -0.0384; -0.0334; -0.0285; -0.0236; -0.0144; -0.01; 0.0024; 0.0099; 0.0157; 0.0203; 0.0238; NaN],
  cn=[-1.055; -0.869; -0.682; -0.496; -0.313; -0.222; -0.134; 0.039; 0.126; 0.215; 0.307; 0.4; 0.59; 0.687; 0.981; 1.175; 1.32; 1.434; 1.509; 1.517],
  ca=[-0.192; -0.131; -0.081; -0.04; -0.01; 0.001; 0.01; 0.02; 0.021; 0.02; 0.017; 0.011; -0.008; -0.021; -0.076; -0.126; -0.181; -0.242; -0.305; -0.36],
  xcp=[0.114; 0.121; 0.134; 0.157; 0.21; 0.269; 0.405; -1.126; -0.305; -0.155; -0.093; -0.059; -0.024; -0.015; 0.002; 0.008; 0.012; 0.014; 0.016; NaN],
  cma=[0.007579; 0.007203; 0.006816; 0.006406; 0.005981; 0.005763; 0.005544; 0.005184; 0.005065; 0.004965; 0.004857; 0.004741; 0.004491; 0.004355; 0.003903; 0.003315; 0.002596; 0.002017; 0.001442; NaN],
  cyb=repmat(0, 20, 1),
  cnb=repmat(0, 20, 1),
  clb=[1.368e-5; -5.977e-5; -0.000133; -0.0002052; -0.0002759; -0.0003104; -0.0003443; -0.0004101; -0.0004433; -0.0004773; -0.0005121; -0.0005476; -0.0006202; -0.0006572; -0.0007701; -0.0008453; -0.0009028; -0.000949; -0.0009813; -0.0009887],
  cla=[0.0963; 0.09597; 0.09519; 0.09353; 0.09108; 0.08955; 0.08782; 0.08664; 0.08801; 0.09007; 0.09194; 0.09357; 0.0963; 0.0973; 0.09847; 0.08685; 0.06782; 0.05137; 0.02597; -0.006757],
  clq=repmat(0.03838, 20, 1),
  cmq=repmat(-0.004166, 20, 1),
  clad=[NaN; 99999; 99999; 99999; 99999; 99999; 99999; 99999; 99999; 99999; 99999; 99999; 99999; 99999; 99999; 99999; 99999; 99999; 99999; 99999],
  cmad=[NaN; 99999; 99999; 99999; 99999; 99999; 99999; 99999; 99999; 99999; 99999; 99999; 99999; 99999; 99999; 99999; 99999; 99999; 99999; 99999],
  clp=[-0.009557; -0.009504; -0.009411; -0.009236; -0.008988; -0.008834; -0.008663; -0.008546; -0.008682; -0.008886; -0.009072; -0.009236; -0.009514; -0.009619; -0.009761; -0.008641; -0.00679; -0.00519; -0.002708; 0.0005064],
  cyp=[0.001031; 0.0008452; 0.000661; 0.0004798; 0.0003024; 0.0002154; 0.0001294; -3.834e-5; -0.0001229; -0.000209; -0.0002965; -0.0003853; -0.0005664; -0.0006585; -0.0009413; -0.00115; -0.001336; -0.001501; -0.001668; -0.001751],
  cnp=[0.001196; 0.0009816; 0.0007686; 0.0005609; 0.0003568; 0.0002557; 0.0001544; -4.598e-5; -0.0001468; -0.0002476; -0.0003488; -0.0004501; -0.0006548; -0.0007587; -0.001083; -0.001401; -0.001745; -0.002056; -0.002407; -0.002587],
  cnr=[-0.0003727; -0.0002732; -0.0001936; -0.0001342; -9.441e-5; -8.16e-5; -7.324e-5; -6.897e-5; -7.279e-5; -8.088e-5; -9.35e-5; -0.0001109; -0.0001609; -0.0001937; -0.0003247; -0.0004377; -0.000538; -0.0006272; -0.0006944; -0.0007102],
  clr=[-0.004201; -0.003446; -0.002694; -0.001951; -0.001225; -0.0008698; -0.0005215; 0.0001543; 0.0004957; 0.0008455; 0.001203; 0.001567; 0.002314; 0.002695; 0.003855; 0.004628; 0.005219; 0.005693; 0.006026; 0.006101],
  dcl_sym=[0; 0.122; 0.244; 0.356; 0.388],
  dcm_sym=[0; -0.0113; -0.0225; -0.0304; -0.0504],
  dclmax_sym=[0; 0.087; 0.169; 0.235; 0.292],
  dcdmin_sym=[0; 0.00322; 0.00796; 0.017; 0.02439],
  clad_sym=repmat(NaN, 5, 1),
  cha_sym=[-0.008852; 99999; 99999; 99999; 99999],
  chd_sym=[-0.01624; -0.01624; -0.01624; -0.01627; -0.0165],
  dcdi_sym=[-1.88e-5 -0.00832 -0.0145 -0.0183 -0.019
   -1.55e-5 -0.00669 -0.0112 -0.0135 -0.0138
   -1.23e-5 -0.00506 -0.00798 -0.00878 -0.00867
   -9.0e-6 -0.00343 -0.00473 -0.00403 -0.0035
   -5.75e-6 -0.00181 -0.00147 0.000723 0.00168
   -4.13e-6 -0.000995 0.000153 0.0031 0.00427
   -2.5e-6 -0.000181 0.00178 0.00547 0.00685
   7.54e-7 0.00145 0.00503 0.0102 0.012
   2.38e-6 0.00226 0.00666 0.0126 0.0146
   4.01e-6 0.00307 0.00829 0.015 0.0172
   5.63e-6 0.00389 0.00991 0.0173 0.0198
   7.26e-6 0.0047 0.0115 0.0197 0.0224
   1.05e-5 0.00633 0.0148 0.0245 0.0276
   1.21e-5 0.00714 0.0164 0.0268 0.0301
   1.7e-5 0.00958 0.0213 0.034 0.0379
   2.03e-5 0.0112 0.0246 0.0387 0.0431
   2.35e-5 0.0128 0.0278 0.0435 0.0483
   2.68e-5 0.0145 0.0311 0.0482 0.0534
   3.01e-5 0.0161 0.0343 0.053 0.0586
   3.33e-5 0.0177 0.0376 0.0577 0.0638]), struct(
  case="AILERONS: UAV",
  mach=0.05,
  alt=100,
  alpha=[-14 -12 -10 -8 -6 -5 -4 -2 -1 0 1 2 4 5 8 10 12 14 16 18],
  nmach=1,
  nalt=1,
  nalpha=20,
  rnnub=[],
  hypers=false,
  loop=1,
  sref=3.561,
  cbar=0.613,
  blref=5.91,
  dim="ft",
  deriv="deg",
  stmach=0.6,
  tsmach=1.4,
  save=false,
  stype=4,
  trim=false,
  damp=true,
  build=1,
  part=false,
  highsym=false,
  highasy=true,
  highcon=false,
  tjet=false,
  hypeff=false,
  lb=false,
  pwr=false,
  grnd=false,
  wsspn=2.6575,
  hsspn=1,
  ndelta=9,
  delta=[],
  deltal=[-32 -20 -10 -5 0 5 10 20 32],
  deltar=[32 20 10 5 0 -5 -10 -20 -32],
  ngh=0,
  grndht=[],
  config=struct(downwash=false, body=true, wing=true, htail=false, vtail=false, vfin=false),
  version=1976,
  cd=[0.069; 0.053; 0.039; 0.029; 0.022; 0.02; 0.019; 0.018; 0.019; 0.02; 0.022; 0.025; 0.034; 0.039; 0.061; 0.08; 0.097; 0.112; 0.123; 0.126],
  cl=[-1.07; -0.878; -0.686; -0.497; -0.312; -0.222; -0.133; 0.039; 0.126; 0.215; 0.306; 0.399; 0.589; 0.686; 0.982; 1.179; 1.329; 1.45; 1.535; 1.554],
  cm=[-0.1201; -0.1053; -0.0913; -0.0781; -0.0657; -0.0598; -0.0541; -0.0435; -0.0384; -0.0334; -0.0285; -0.0236; -0.0144; -0.01; 0.0024; 0.0099; 0.0157; 0.0203; 0.0238; NaN],
  cn=[-1.055; -0.869; -0.682; -0.496; -0.313; -0.222; -0.134; 0.039; 0.126; 0.215; 0.307; 0.4; 0.59; 0.687; 0.981; 1.175; 1.32; 1.434; 1.509; 1.517],
  ca=[-0.192; -0.131; -0.081; -0.04; -0.01; 0.001; 0.01; 0.02; 0.021; 0.02; 0.017; 0.011; -0.008; -0.021; -0.076; -0.126; -0.181; -0.242; -0.305; -0.36],
  xcp=[0.114; 0.121; 0.134; 0.157; 0.21; 0.269; 0.405; -1.126; -0.305; -0.155; -0.093; -0.059; -0.024; -0.015; 0.002; 0.008; 0.012; 0.014; 0.016; NaN],
  cma=[0.007579; 0.007203; 0.006816; 0.006406; 0.005981; 0.005763; 0.005544; 0.005184; 0.005065; 0.004965; 0.004857; 0.004741; 0.004491; 0.004355; 0.003903; 0.003315; 0.002596; 0.002017; 0.001442; NaN],
  cyb=repmat(0, 20, 1),
  cnb=repmat(0, 20, 1),
  clb=[1.368e-5; -5.977e-5; -0.000133; -0.0002052; -0.0002759; -0.0003104; -0.0003443; -0.0004101; -0.0004433; -0.0004773; -0.0005121; -0.0005476; -0.0006202; -0.0006572; -0.0007701; -0.0008453; -0.0009028; -0.000949; -0.0009813; -0.0009887],
  cla=[0.0963; 0.09597; 0.09519; 0.09353; 0.09108; 0.08955; 0.08782; 0.08664; 0.08801; 0.09007; 0.09194; 0.09357; 0.0963; 0.0973; 0.09847; 0.08685; 0.06782; 0.05137; 0.02597; -0.006757],
  clq=repmat(0.03838, 20, 1),
  cmq=repmat(-0.004166, 20, 1),
  clad=[NaN; 99999; 99999; 99999; 99999; 99999; 99999; 99999; 99999; 99999; 99999; 99999; 99999; 99999; 99999; 99999; 99999; 99999; 99999; 99999],
  cmad=[NaN; 99999; 99999; 99999; 99999; 99999; 99999; 99999; 99999; 99999; 99999; 99999; 99999; 99999; 99999; 99999; 99999; 99999; 99999; 99999],
  clp=[-0.009557; -0.009504; -0.009411; -0.009236; -0.008988; -0.008834; -0.008663; -0.008546; -0.008682; -0.008886; -0.009072; -0.009236; -0.009514; -0.009619; -0.009761; -0.008641; -0.00679; -0.00519; -0.002708; 0.0005064],
  cyp=[0.001031; 0.0008452; 0.000661; 0.0004798; 0.0003024; 0.0002154; 0.0001294; -3.834e-5; -0.0001229; -0.000209; -0.0002965; -0.0003853; -0.0005664; -0.0006585; -0.0009413; -0.00115; -0.001336; -0.001501; -0.001668; -0.001751],
  cnp=[0.001196; 0.0009816; 0.0007686; 0.0005609; 0.0003568; 0.0002557; 0.0001544; -4.598e-5; -0.0001468; -0.0002476; -0.0003488; -0.0004501; -0.0006548; -0.0007587; -0.001083; -0.001401; -0.001745; -0.002056; -0.002407; -0.002587],
  cnr=[-0.0003727; -0.0002732; -0.0001936; -0.0001342; -9.441e-5; -8.16e-5; -7.324e-5; -6.897e-5; -7.279e-5; -8.088e-5; -9.35e-5; -0.0001109; -0.0001609; -0.0001937; -0.0003247; -0.0004377; -0.000538; -0.0006272; -0.0006944; -0.0007102],
  clr=[-0.004201; -0.003446; -0.002694; -0.001951; -0.001225; -0.0008698; -0.0005215; 0.0001543; 0.0004957; 0.0008455; 0.001203; 0.001567; 0.002314; 0.002695; 0.003855; 0.004628; 0.005219; 0.005693; 0.006026; 0.006101],
  clroll=[-0.094298; -0.07954; -0.046531; -0.023266; 0; 0.023266; 0.046531; 0.07954; 0.094298],
  cn_asy=[-0.01206 -0.01017 -0.005952 -0.002976 0 0.002976 0.005952 0.01017 0.01206
   -0.009895 -0.008346 -0.004883 -0.002441 0 0.002441 0.004883 0.008346 0.009895
   -0.007735 -0.006524 -0.003817 -0.001908 0 0.001908 0.003817 0.006524 0.007735
   -0.005602 -0.004725 -0.002764 -0.001382 0 0.001382 0.002764 0.004725 0.005602
   -0.003517 -0.002966 -0.001735 -0.0008676 0 0.0008676 0.001735 0.002966 0.003517
   -0.002498 -0.002107 -0.001232 -0.0006162 0 0.0006162 0.001232 0.002107 0.002498
   -0.001497 -0.001263 -0.0007389 -0.0003694 0 0.0003694 0.0007389 0.001263 0.001497
   0.0004431 0.0003738 0.0002186 0.0001093 0 -0.0001093 -0.0002186 -0.0003738 -0.0004431
   0.001423 0.001201 0.0007023 0.0003512 0 -0.0003512 -0.0007023 -0.001201 -0.001423
   0.002428 0.002048 0.001198 0.000599 0 -0.000599 -0.001198 -0.002048 -0.002428
   0.003454 0.002914 0.001705 0.0008523 0 -0.0008523 -0.001705 -0.002914 -0.003454
   0.004501 0.003796 0.002221 0.00111 0 -0.00111 -0.002221 -0.003796 -0.004501
   0.006645 0.005605 0.003279 0.001639 0 -0.001639 -0.003279 -0.005605 -0.006645
   0.007737 0.006526 0.003818 0.001909 0 -0.001909 -0.003818 -0.006526 -0.007737
   0.01107 0.009337 0.005462 0.002731 0 -0.002731 -0.005462 -0.009337 -0.01107
   0.01329 0.01121 0.006558 0.003279 0 -0.003279 -0.006558 -0.01121 -0.01329
   0.01499 0.01264 0.007395 0.003697 0 -0.003697 -0.007395 -0.01264 -0.01499
   0.01635 0.01379 0.008067 0.004033 0 -0.004033 -0.008067 -0.01379 -0.01635
   0.0173 0.01459 0.008538 0.004269 0 -0.004269 -0.008538 -0.01459 -0.0173
   0.01752 0.01478 0.008645 0.004322 0 -0.004322 -0.008645 -0.01478 -0.01752]), struct(
  case="TOTAL: TOTAL: UAV",
  mach=0.05,
  alt=100,
  alpha=[-14 -12 -10 -8 -6 -5 -4 -2 -1 0 1 2 4 5 8 10 12 14 16 18],
  nmach=1,
  nalt=1,
  nalpha=20,
  rnnub=[],
  hypers=false,
  loop=1,
  sref=3.561,
  cbar=0.613,
  blref=5.91,
  dim="ft",
  deriv="deg",
  stmach=0.6,
  tsmach=1.4,
  save=false,
  stype=[],
  trim=false,
  damp=true,
  build=1,
  part=false,
  highsym=true,
  highasy=false,
  highcon=false,
  tjet=false,
  hypeff=false,
  lb=false,
  pwr=false,
  grnd=false,
  wsspn=2.6575,
  hsspn=0.656,
  ndelta=8,
  delta=[-15 -10 -5 0 5 10 13 16],
  deltal=[],
  deltar=[],
  ngh=0,
  grndht=[],
  config=struct(downwash=true, body=true, wing=true, htail=true, vtail=true, vfin=false),
  version=1976,
  cd=[0.094; 0.071; 0.054; 0.04; 0.03; 0.027; 0.025; 0.022; 0.023; 0.024; 0.026; 0.029; 0.038; 0.044; 0.07; 0.092; 0.113; 0.133; 0.151; 0.162],
  cl=[-1.161; -0.957; -0.753; -0.553; -0.356; -0.259; -0.164; 0.02; 0.113; 0.208; 0.304; 0.402; 0.604; 0.706; 1.019; 1.228; 1.391; 1.526; 1.627; 1.661],
  cm=[0.2721; 0.2325; 0.1954; 0.1577; 0.1187; 0.0986; 0.0788; 0.0364; 0.0157; -0.0024; -0.0189; -0.0362; -0.0746; -0.0944; -0.156; -0.1994; -0.2494; -0.3096; -0.377; -0.42],
  cn=[-1.149; -0.951; -0.751; -0.553; -0.357; -0.26; -0.166; 0.02; 0.113; 0.208; 0.304; 0.403; 0.605; 0.707; 1.019; 1.225; 1.384; 1.513; 1.606; 1.63],
  ca=[-0.19; -0.129; -0.078; -0.038; -0.007; 0.004; 0.013; 0.023; 0.025; 0.024; 0.021; 0.015; -0.004; -0.017; -0.073; -0.123; -0.179; -0.24; -0.303; -0.36],
  xcp=[-0.237; -0.245; -0.26; -0.285; -0.333; -0.378; -0.475; 1.865; 0.139; -0.011; -0.062; -0.09; -0.123; -0.133; -0.153; -0.163; -0.18; -0.205; -0.235; -0.25],
  cma=[-0.007052; -0.01918; -0.01872; -0.01916; -0.01994; -0.01998; -0.02026; -0.02083; -0.01936; -0.01733; -0.01693; -0.01792; -0.01958; -0.01996; -0.02123; -0.02336; -0.02756; -0.03189; -0.03544; -0.038],
  cyb=repmat(-0.002563, 20, 1),
  cnb=repmat(0, 20, 1),
  clb=[-0.00028; -0.0003298; -0.0003818; -0.0004338; -0.0004837; -0.0005075; -0.0005306; -0.0005742; -0.0005961; -0.0006186; -0.0006418; -0.0006657; -0.0007157; -0.0007416; -0.0008213; -0.0008747; -0.0009092; -0.0009294; -0.0009335; -0.0009097],
  cla=[0.1001; 0.1019; 0.101; 0.09945; 0.09716; 0.09561; 0.09393; 0.09281; 0.09381; 0.09537; 0.09711; 0.09895; 0.102; 0.103; 0.1043; 0.09297; 0.07467; 0.05897; 0.03373; 0.0007767],
  qqinf=[1; 1; 1; 1; 1; 1; 1; 0.974; 0.941; 0.922; 0.931; 0.961; 1; 1; 1; 1; 1; 1; 1; 1],
  eps=[-4.153; -3.469; -2.744; -2.012; -1.28; -0.915; -0.553; 0.165; 0.531; 0.904; 1.277; 1.653; 2.409; 2.787; 3.912; 4.629; 5.244; 5.65; 5.947; 6.083],
  depsdalp=[0.342; 0.352; 0.364; 0.366; 0.365; 0.364; 0.361; 0.363; 0.369; 0.373; 0.374; 0.377; 0.378; 0.378; 0.365; 0.333; 0.255; 0.176; 0.108; 0.068],
  clq=repmat(0.08712, 20, 1),
  cmq=repmat(-0.2078, 20, 1),
  clad=[0.01665; 0.01716; 0.01775; 0.01784; 0.01779; 0.01772; 0.01761; 0.01725; 0.01694; 0.01676; 0.017; 0.01764; 0.01845; 0.01841; 0.01779; 0.01622; 0.01243; 0.008565; 0.005278; 0.003319],
  cmad=[-0.06957; -0.07171; -0.07418; -0.07453; -0.07434; -0.07402; -0.07356; -0.07206; -0.07075; -0.07003; -0.07102; -0.07371; -0.07707; -0.07694; -0.07434; -0.06778; -0.05194; -0.03578; -0.02205; -0.01387],
  clp=[-0.00964; -0.009576; -0.009472; -0.009286; -0.009027; -0.008869; -0.008694; -0.008569; -0.008701; -0.008903; -0.009088; -0.009251; -0.009529; -0.009635; -0.00978; -0.008665; -0.006818; -0.005223; -0.002747; 0.0004587],
  cyp=[0.0005541; 0.0004347; 0.0003173; 0.0002036; 9.446e-5; 4.177e-5; -9.705e-6; -0.0001081; -0.0001579; -0.000209; -0.0002615; -0.0003152; -0.0004259; -0.0004828; -0.0006596; -0.000798; -0.0009135; -0.001008; -0.001104; -0.001117],
  cnp=[0.001371; 0.001134; 0.0008976; 0.0006656; 0.0004364; 0.0003224; 0.0002081; -1.887e-5; -0.0001332; -0.0002476; -0.0003625; -0.0004776; -0.0007101; -0.000828; -0.001194; -0.00154; -0.001911; -0.00225; -0.002627; -0.002833],
  cnr=[-0.001059; -0.0009782; -0.0009158; -0.0008719; -0.0008461; -0.0008397; -0.0008372; -0.0008434; -0.0008518; -0.0008639; -0.0008802; -0.0009007; -0.0009556; -0.0009901; -0.001123; -0.001235; -0.001333; -0.001417; -0.001478; -0.001485],
  clr=[-0.003923; -0.003189; -0.002459; -0.001739; -0.001037; -0.0006944; -0.0003587; 0.0002912; 0.0006194; 0.0009559; 0.0013; 0.001651; 0.00237; 0.002737; 0.003855; 0.004601; 0.005164; 0.005611; 0.005916; 0.005965],
  dcl_sym=[-0.048; -0.033; -0.016; 0; 0.016; 0.033; 0.042; 0.051],
  dcm_sym=[0.2769; 0.1892; 0.0946; -0.0002; -0.0946; -0.1892; -0.2435; -0.2919],
  dclmax_sym=[0.057; 0.041; 0.021; 0; 0.021; 0.041; 0.05; 0.06],
  dcdmin_sym=[0.0022; 0.0009; 0.00045; 0; 0.00045; 0.0009; 0.00168; 0.0025],
  clad_sym=repmat(NaN, 8, 1),
  cha_sym=[-0.003166; 99999; 99999; 99999; 99999; 99999; 99999; 99999],
  chd_sym=[-0.01248; -0.01242; -0.01242; -0.01242; -0.01242; -0.01242; -0.01244; -0.01251],
  dcdi_sym=[0.00815 0.00496 0.00216 -3.67e-6 -0.00151 -0.00238 -0.00259 -0.00259
   0.00719 0.0043 0.00183 -3.01e-6 -0.00119 -0.00173 -0.00175 -0.00158
   0.00626 0.00367 0.00151 -2.38e-6 -0.000869 -0.00109 -0.000931 -0.000605
   0.00534 0.00304 0.0012 -1.75e-6 -0.000554 -0.000464 -0.000118 0.000368
   0.00441 0.00241 0.000883 -1.12e-6 -0.000239 0.000166 0.000693 0.00134
   0.00395 0.00209 0.000725 -8.05e-7 -8.14e-5 0.000481 0.0011 0.00183
   0.00349 0.00178 0.000567 -4.89e-7 7.7e-5 0.000798 0.00151 0.00232
   0.00255 0.00114 0.000249 1.48e-7 0.000396 0.00144 0.00233 0.0033
   0.00209 0.000826 9.1e-5 4.63e-7 0.000553 0.00175 0.00274 0.00379
   0.00163 0.000515 -6.47e-5 7.75e-7 0.000709 0.00206 0.00314 0.00427
   0.00118 0.000203 -0.000221 1.09e-6 0.000865 0.00237 0.00354 0.00475
   0.000724 -0.000107 -0.000375 1.4e-6 0.00102 0.00268 0.00394 0.00523
   -0.000183 -0.000725 -0.000685 2.01e-6 0.00133 0.0033 0.00474 0.00619
   -0.000635 -0.00103 -0.000839 2.32e-6 0.00148 0.00361 0.00513 0.00666
   -0.002 -0.00197 -0.0013 3.25e-6 0.00195 0.00454 0.00633 0.0081
   -0.00294 -0.0026 -0.00162 3.89e-6 0.00227 0.00518 0.00716 0.00909
   -0.00394 -0.00329 -0.00197 4.58e-6 0.00261 0.00587 0.00804 0.0102
   -0.00511 -0.00408 -0.00236 5.37e-6 0.00301 0.00666 0.00906 0.0114
   -0.00635 -0.00493 -0.00279 6.22e-6 0.00343 0.00751 0.0102 0.0127
   -0.0077 -0.00586 -0.00325 7.14e-6 0.00389 0.00843 0.0113 0.0141])}

datcom1 = {struct(
  case="FLAPS: UAV",
  mach=0.05,
  alt=100,
  alpha=[-14 -12 -10 -8 -6 -5 -4 -2 -1 0 1 2 4 5 8 10 12 14 16 18],
  nmach=1,
  nalt=1,
  nalpha=20,
  rnnub=[],
  hypers=false,
  loop=1,
  sref=3.561,
  cbar=0.613,
  blref=5.91,
  dim="ft",
  deriv="deg",
  stmach=0.6,
  tsmach=1.4,
  save=false,
  stype=[],
  trim=false,
  damp=true,
  build=1,
  part=false,
  highsym=true,
  highasy=false,
  highcon=false,
  tjet=false,
  hypeff=false,
  lb=false,
  pwr=false,
  grnd=false,
  wsspn=2.6575,
  hsspn=1,
  ndelta=5,
  delta=[0 5 10 15 20],
  deltal=[],
  deltar=[],
  ngh=0,
  grndht=[],
  config=struct(downwash=false, body=true, wing=true, htail=false, vtail=false, vfin=false),
  version=1976,
  cd=[0.069; 0.053; 0.039; 0.029; 0.022; 0.02; 0.019; 0.018; 0.019; 0.02; 0.022; 0.025; 0.034; 0.039; 0.061; 0.08; 0.097; 0.112; 0.123; 0.126],
  cl=[-1.07; -0.878; -0.686; -0.497; -0.312; -0.222; -0.133; 0.039; 0.126; 0.215; 0.306; 0.399; 0.589; 0.686; 0.982; 1.179; 1.329; 1.45; 1.535; 1.554],
  cm=[-0.1559; -0.1345; -0.114; -0.0944; -0.0759; -0.0671; -0.0585; -0.0422; -0.0343; -0.0263; -0.0185; -0.0106; 0.0049; 0.0125; 0.0348; 0.0489; 0.0599; 0.0689; 0.0756; NaN],
  cn=[-1.055; -0.869; -0.682; -0.496; -0.313; -0.222; -0.134; 0.039; 0.126; 0.215; 0.307; 0.4; 0.59; 0.687; 0.981; 1.175; 1.32; 1.434; 1.509; 1.517],
  ca=[-0.192; -0.131; -0.081; -0.04; -0.01; 0.001; 0.01; 0.02; 0.021; 0.02; 0.017; 0.011; -0.008; -0.021; -0.076; -0.126; -0.181; -0.242; -0.305; -0.36],
  xcp=[0.148; 0.155; 0.167; 0.19; 0.243; 0.301; 0.437; -1.093; -0.272; -0.122; -0.06; -0.027; 0.008; 0.018; 0.035; 0.042; 0.045; 0.048; 0.05; NaN],
  cma=[0.01093; 0.01049; 0.01002; 0.009519; 0.008983; 0.008704; 0.008421; 0.008013; 0.007937; 0.007905; 0.007862; 0.007805; 0.007661; 0.007573; 0.007215; 0.00629; 0.004991; 0.003915; 0.002787; NaN],
  cyb=repmat(0, 20, 1),
  cnb=repmat(0, 20, 1),
  clb=[1.368e-5; -5.977e-5; -0.000133; -0.0002052; -0.0002759; -0.0003104; -0.0003443; -0.0004101; -0.0004433; -0.0004773; -0.0005121; -0.0005476; -0.0006202; -0.0006572; -0.0007701; -0.0008453; -0.0009028; -0.000949; -0.0009813; -0.0009887],
  cla=[0.0963; 0.09597; 0.09519; 0.09353; 0.09108; 0.08955; 0.08782; 0.08664; 0.08801; 0.09007; 0.09194; 0.09357; 0.0963; 0.0973; 0.09847; 0.08685; 0.06782; 0.05137; 0.02597; -0.006757],
  clq=repmat(0.03285, 20, 1),
  cmq=repmat(-0.003691, 20, 1),
  clad=[NaN; 99999; 99999; 99999; 99999; 99999; 99999; 99999; 99999; 99999; 99999; 99999; 99999; 99999; 99999; 99999; 99999; 99999; 99999; 99999],
  cmad=[NaN; 99999; 99999; 99999; 99999; 99999; 99999; 99999; 99999; 99999; 99999; 99999; 99999; 99999; 99999; 99999; 99999; 99999; 99999; 99999],
  clp=[-0.009557; -0.009504; -0.009411; -0.009236; -0.008988; -0.008834; -0.008663; -0.008546; -0.008682; -0.008886; -0.009072; -0.009236; -0.009514; -0.009619; -0.009761; -0.008641; -0.00679; -0.00519; -0.002708; 0.0005064],
  cyp=[0.001031; 0.0008452; 0.000661; 0.0004798; 0.0003024; 0.0002154; 0.0001294; -3.834e-5; -0.0001229; -0.000209; -0.0002965; -0.0003853; -0.0005664; -0.0006585; -0.0009413; -0.00115; -0.001336; -0.001501; -0.001668; -0.001751],
  cnp=[0.001196; 0.0009816; 0.0007686; 0.0005609; 0.0003568; 0.0002557; 0.0001544; -4.598e-5; -0.0001468; -0.0002476; -0.0003488; -0.0004501; -0.0006548; -0.0007587; -0.001083; -0.001401; -0.001745; -0.002056; -0.002407; -0.002587],
  cnr=[-0.0003727; -0.0002732; -0.0001936; -0.0001342; -9.441e-5; -8.16e-5; -7.324e-5; -6.897e-5; -7.279e-5; -8.088e-5; -9.35e-5; -0.0001109; -0.0001609; -0.0001937; -0.0003247; -0.0004377; -0.000538; -0.0006272; -0.0006944; -0.0007102],
  clr=[-0.004201; -0.003446; -0.002694; -0.001951; -0.001225; -0.0008698; -0.0005215; 0.0001543; 0.0004957; 0.0008455; 0.001203; 0.001567; 0.002314; 0.002695; 0.003855; 0.004628; 0.005219; 0.005693; 0.006026; 0.006101],
  dcl_sym=[0; 0.122; 0.244; 0.356; 0.388],
  dcm_sym=[0; -0.007; -0.0139; -0.0178; -0.0367],
  dclmax_sym=[0; 0.087; 0.169; 0.235; 0.292],
  dcdmin_sym=[0; 0.00322; 0.00796; 0.017; 0.02439],
  clad_sym=repmat(NaN, 5, 1),
  cha_sym=[-0.008852; 99999; 99999; 99999; 99999],
  chd_sym=[-0.01624; -0.01624; -0.01624; -0.01627; -0.0165],
  dcdi_sym=[-1.88e-5 -0.00832 -0.0145 -0.0183 -0.019
   -1.55e-5 -0.00669 -0.0112 -0.0135 -0.0138
   -1.23e-5 -0.00506 -0.00798 -0.00878 -0.00867
   -9.0e-6 -0.00343 -0.00473 -0.00403 -0.0035
   -5.75e-6 -0.00181 -0.00147 0.000723 0.00168
   -4.13e-6 -0.000995 0.000153 0.0031 0.00427
   -2.5e-6 -0.000181 0.00178 0.00547 0.00685
   7.54e-7 0.00145 0.00503 0.0102 0.012
   2.38e-6 0.00226 0.00666 0.0126 0.0146
   4.01e-6 0.00307 0.00829 0.015 0.0172
   5.63e-6 0.00389 0.00991 0.0173 0.0198
   7.26e-6 0.0047 0.0115 0.0197 0.0224
   1.05e-5 0.00633 0.0148 0.0245 0.0276
   1.21e-5 0.00714 0.0164 0.0268 0.0301
   1.7e-5 0.00958 0.0213 0.034 0.0379
   2.03e-5 0.0112 0.0246 0.0387 0.0431
   2.35e-5 0.0128 0.0278 0.0435 0.0483
   2.68e-5 0.0145 0.0311 0.0482 0.0534
   3.01e-5 0.0161 0.0343 0.053 0.0586
   3.33e-5 0.0177 0.0376 0.0577 0.0638]), struct(
  case="AILERONS: UAV",
  mach=0.05,
  alt=100,
  alpha=[-14 -12 -10 -8 -6 -5 -4 -2 -1 0 1 2 4 5 8 10 12 14 16 18],
  nmach=1,
  nalt=1,
  nalpha=20,
  rnnub=[],
  hypers=false,
  loop=1,
  sref=3.561,
  cbar=0.613,
  blref=5.91,
  dim="ft",
  deriv="deg",
  stmach=0.6,
  tsmach=1.4,
  save=false,
  stype=4,
  trim=false,
  damp=true,
  build=1,
  part=false,
  highsym=false,
  highasy=true,
  highcon=false,
  tjet=false,
  hypeff=false,
  lb=false,
  pwr=false,
  grnd=false,
  wsspn=2.6575,
  hsspn=1,
  ndelta=9,
  delta=[],
  deltal=[-32 -20 -10 -5 0 5 10 20 32],
  deltar=[32 20 10 5 0 -5 -10 -20 -32],
  ngh=0,
  grndht=[],
  config=struct(downwash=false, body=true, wing=true, htail=false, vtail=false, vfin=false),
  version=1976,
  cd=[0.069; 0.053; 0.039; 0.029; 0.022; 0.02; 0.019; 0.018; 0.019; 0.02; 0.022; 0.025; 0.034; 0.039; 0.061; 0.08; 0.097; 0.112; 0.123; 0.126],
  cl=[-1.07; -0.878; -0.686; -0.497; -0.312; -0.222; -0.133; 0.039; 0.126; 0.215; 0.306; 0.399; 0.589; 0.686; 0.982; 1.179; 1.329; 1.45; 1.535; 1.554],
  cm=[-0.1559; -0.1345; -0.114; -0.0944; -0.0759; -0.0671; -0.0585; -0.0422; -0.0343; -0.0263; -0.0185; -0.0106; 0.0049; 0.0125; 0.0348; 0.0489; 0.0599; 0.0689; 0.0756; NaN],
  cn=[-1.055; -0.869; -0.682; -0.496; -0.313; -0.222; -0.134; 0.039; 0.126; 0.215; 0.307; 0.4; 0.59; 0.687; 0.981; 1.175; 1.32; 1.434; 1.509; 1.517],
  ca=[-0.192; -0.131; -0.081; -0.04; -0.01; 0.001; 0.01; 0.02; 0.021; 0.02; 0.017; 0.011; -0.008; -0.021; -0.076; -0.126; -0.181; -0.242; -0.305; -0.36],
  xcp=[0.148; 0.155; 0.167; 0.19; 0.243; 0.301; 0.437; -1.093; -0.272; -0.122; -0.06; -0.027; 0.008; 0.018; 0.035; 0.042; 0.045; 0.048; 0.05; NaN],
  cma=[0.01093; 0.01049; 0.01002; 0.009519; 0.008983; 0.008704; 0.008421; 0.008013; 0.007937; 0.007905; 0.007862; 0.007805; 0.007661; 0.007573; 0.007215; 0.00629; 0.004991; 0.003915; 0.002787; NaN],
  cyb=repmat(0, 20, 1),
  cnb=repmat(0, 20, 1),
  clb=[1.368e-5; -5.977e-5; -0.000133; -0.0002052; -0.0002759; -0.0003104; -0.0003443; -0.0004101; -0.0004433; -0.0004773; -0.0005121; -0.0005476; -0.0006202; -0.0006572; -0.0007701; -0.0008453; -0.0009028; -0.000949; -0.0009813; -0.0009887],
  cla=[0.0963; 0.09597; 0.09519; 0.09353; 0.09108; 0.08955; 0.08782; 0.08664; 0.08801; 0.09007; 0.09194; 0.09357; 0.0963; 0.0973; 0.09847; 0.08685; 0.06782; 0.05137; 0.02597; -0.006757],
  clq=repmat(0.03285, 20, 1),
  cmq=repmat(-0.003691, 20, 1),
  clad=[NaN; 99999; 99999; 99999; 99999; 99999; 99999; 99999; 99999; 99999; 99999; 99999; 99999; 99999; 99999; 99999; 99999; 99999; 99999; 99999],
  cmad=[NaN; 99999; 99999; 99999; 99999; 99999; 99999; 99999; 99999; 99999; 99999; 99999; 99999; 99999; 99999; 99999; 99999; 99999; 99999; 99999],
  clp=[-0.009557; -0.009504; -0.009411; -0.009236; -0.008988; -0.008834; -0.008663; -0.008546; -0.008682; -0.008886; -0.009072; -0.009236; -0.009514; -0.009619; -0.009761; -0.008641; -0.00679; -0.00519; -0.002708; 0.0005064],
  cyp=[0.001031; 0.0008452; 0.000661; 0.0004798; 0.0003024; 0.0002154; 0.0001294; -3.834e-5; -0.0001229; -0.000209; -0.0002965; -0.0003853; -0.0005664; -0.0006585; -0.0009413; -0.00115; -0.001336; -0.001501; -0.001668; -0.001751],
  cnp=[0.001196; 0.0009816; 0.0007686; 0.0005609; 0.0003568; 0.0002557; 0.0001544; -4.598e-5; -0.0001468; -0.0002476; -0.0003488; -0.0004501; -0.0006548; -0.0007587; -0.001083; -0.001401; -0.001745; -0.002056; -0.002407; -0.002587],
  cnr=[-0.0003727; -0.0002732; -0.0001936; -0.0001342; -9.441e-5; -8.16e-5; -7.324e-5; -6.897e-5; -7.279e-5; -8.088e-5; -9.35e-5; -0.0001109; -0.0001609; -0.0001937; -0.0003247; -0.0004377; -0.000538; -0.0006272; -0.0006944; -0.0007102],
  clr=[-0.004201; -0.003446; -0.002694; -0.001951; -0.001225; -0.0008698; -0.0005215; 0.0001543; 0.0004957; 0.0008455; 0.001203; 0.001567; 0.002314; 0.002695; 0.003855; 0.004628; 0.005219; 0.005693; 0.006026; 0.006101],
  clroll=[-0.094298; -0.07954; -0.046531; -0.023266; 0; 0.023266; 0.046531; 0.07954; 0.094298],
  cn_asy=[-0.01206 -0.01017 -0.005952 -0.002976 0 0.002976 0.005952 0.01017 0.01206
   -0.009895 -0.008346 -0.004883 -0.002441 0 0.002441 0.004883 0.008346 0.009895
   -0.007735 -0.006524 -0.003817 -0.001908 0 0.001908 0.003817 0.006524 0.007735
   -0.005602 -0.004725 -0.002764 -0.001382 0 0.001382 0.002764 0.004725 0.005602
   -0.003517 -0.002966 -0.001735 -0.0008676 0 0.0008676 0.001735 0.002966 0.003517
   -0.002498 -0.002107 -0.001232 -0.0006162 0 0.0006162 0.001232 0.002107 0.002498
   -0.001497 -0.001263 -0.0007389 -0.0003694 0 0.0003694 0.0007389 0.001263 0.001497
   0.0004431 0.0003738 0.0002186 0.0001093 0 -0.0001093 -0.0002186 -0.0003738 -0.0004431
   0.001423 0.001201 0.0007023 0.0003512 0 -0.0003512 -0.0007023 -0.001201 -0.001423
   0.002428 0.002048 0.001198 0.000599 0 -0.000599 -0.001198 -0.002048 -0.002428
   0.003454 0.002914 0.001705 0.0008523 0 -0.0008523 -0.001705 -0.002914 -0.003454
   0.004501 0.003796 0.002221 0.00111 0 -0.00111 -0.002221 -0.003796 -0.004501
   0.006645 0.005605 0.003279 0.001639 0 -0.001639 -0.003279 -0.005605 -0.006645
   0.007737 0.006526 0.003818 0.001909 0 -0.001909 -0.003818 -0.006526 -0.007737
   0.01107 0.009337 0.005462 0.002731 0 -0.002731 -0.005462 -0.009337 -0.01107
   0.01329 0.01121 0.006558 0.003279 0 -0.003279 -0.006558 -0.01121 -0.01329
   0.01499 0.01264 0.007395 0.003697 0 -0.003697 -0.007395 -0.01264 -0.01499
   0.01635 0.01379 0.008067 0.004033 0 -0.004033 -0.008067 -0.01379 -0.01635
   0.0173 0.01459 0.008538 0.004269 0 -0.004269 -0.008538 -0.01459 -0.0173
   0.01752 0.01478 0.008645 0.004322 0 -0.004322 -0.008645 -0.01478 -0.01752]), struct(
  case="TOTAL: TOTAL: UAV",
  mach=0.05,
  alt=100,
  alpha=[-14 -12 -10 -8 -6 -5 -4 -2 -1 0 1 2 4 5 8 10 12 14 16 18],
  nmach=1,
  nalt=1,
  nalpha=20,
  rnnub=[],
  hypers=false,
  loop=1,
  sref=3.561,
  cbar=0.613,
  blref=5.91,
  dim="ft",
  deriv="deg",
  stmach=0.6,
  tsmach=1.4,
  save=false,
  stype=[],
  trim=false,
  damp=true,
  build=1,
  part=false,
  highsym=true,
  highasy=false,
  highcon=false,
  tjet=false,
  hypeff=false,
  lb=false,
  pwr=false,
  grnd=false,
  wsspn=2.6575,
  hsspn=0.656,
  ndelta=8,
  delta=[-15 -10 -5 0 5 10 13 16],
  deltal=[],
  deltar=[],
  ngh=0,
  grndht=[],
  config=struct(downwash=true, body=true, wing=true, htail=true, vtail=true, vfin=false),
  version=1976,
  cd=[0.094; 0.071; 0.054; 0.04; 0.03; 0.027; 0.025; 0.022; 0.023; 0.024; 0.026; 0.029; 0.038; 0.044; 0.07; 0.092; 0.113; 0.133; 0.151; 0.162],
  cl=[-1.161; -0.957; -0.753; -0.553; -0.356; -0.259; -0.164; 0.02; 0.113; 0.208; 0.304; 0.402; 0.604; 0.706; 1.019; 1.228; 1.391; 1.526; 1.627; 1.661],
  cm=[0.2332; 0.2007; 0.1704; 0.1395; 0.1071; 0.0901; 0.0734; 0.037; 0.0194; 0.0044; -0.009; -0.0231; -0.0549; -0.0713; -0.1224; -0.1588; -0.2031; -0.2585; -0.322; -0.4],
  cn=[-1.149; -0.951; -0.751; -0.553; -0.357; -0.26; -0.166; 0.02; 0.113; 0.208; 0.304; 0.403; 0.605; 0.707; 1.019; 1.225; 1.384; 1.513; 1.606; 1.63],
  ca=[-0.19; -0.129; -0.078; -0.038; -0.007; 0.004; 0.013; 0.023; 0.025; 0.024; 0.021; 0.015; -0.004; -0.017; -0.073; -0.123; -0.179; -0.24; -0.303; -0.36],
  xcp=[-0.203; -0.211; -0.227; -0.252; -0.3; -0.346; -0.443; 1.899; 0.172; 0.021; -0.03; -0.057; -0.091; -0.101; -0.12; -0.13; -0.147; -0.171; -0.201; -0.22],
  cma=[-0.003705; -0.01569; -0.01531; -0.01585; -0.01674; -0.01684; -0.01718; -0.0178; -0.0163; -0.01422; -0.01376; -0.01468; -0.01622; -0.01655; -0.01772; -0.02017; -0.02493; -0.02973; -0.03381; -0.039],
  cyb=repmat(-0.002563, 20, 1),
  cnb=repmat(0, 20, 1),
  clb=[-0.0002779; -0.000328; -0.0003803; -0.0004326; -0.0004827; -0.0005068; -0.00053; -0.0005739; -0.0005959; -0.0006186; -0.0006419; -0.0006661; -0.0007163; -0.0007423; -0.0008225; -0.0008762; -0.000911; -0.0009315; -0.0009359; -0.0009124],
  cla=[0.1001; 0.1019; 0.101; 0.09945; 0.09716; 0.09561; 0.09393; 0.09281; 0.09381; 0.09537; 0.09711; 0.09895; 0.102; 0.103; 0.1043; 0.09297; 0.07467; 0.05897; 0.03373; 0.0007767],
  qqinf=[1; 1; 1; 1; 1; 1; 1; 0.974; 0.941; 0.922; 0.931; 0.961; 1; 1; 1; 1; 1; 1; 1; 1],
  eps=[-4.153; -3.469; -2.744; -2.012; -1.28; -0.915; -0.553; 0.165; 0.531; 0.904; 1.277; 1.653; 2.409; 2.787; 3.912; 4.629; 5.244; 5.65; 5.947; 6.083],
  depsdalp=[0.342; 0.352; 0.364; 0.366; 0.365; 0.364; 0.361; 0.363; 0.369; 0.373; 0.374; 0.377; 0.378; 0.378; 0.365; 0.333; 0.255; 0.176; 0.108; 0.068],
  clq=repmat(0.0812, 20, 1),
  cmq=repmat(-0.2041, 20, 1),
  clad=[0.01652; 0.01703; 0.01762; 0.0177; 0.01765; 0.01758; 0.01747; 0.01711; 0.0168; 0.01663; 0.01687; 0.01751; 0.0183; 0.01827; 0.01765; 0.0161; 0.01233; 0.008498; 0.005237; 0.003293],
  cmad=[-0.06849; -0.07059; -0.07302; -0.07337; -0.07318; -0.07287; -0.07241; -0.07094; -0.06965; -0.06894; -0.06991; -0.07257; -0.07587; -0.07574; -0.07318; -0.06672; -0.05113; -0.03523; -0.02171; -0.01365],
  clp=[-0.009639; -0.009575; -0.009472; -0.009286; -0.009027; -0.008869; -0.008693; -0.008569; -0.008701; -0.008903; -0.009088; -0.009251; -0.009529; -0.009635; -0.00978; -0.008665; -0.006817; -0.005223; -0.002747; 0.0004597],
  cyp=[0.0005583; 0.0004383; 0.0003203; 0.000206; 9.627e-5; 4.329e-5; -8.494e-6; -0.0001075; -0.0001576; -0.000209; -0.0002618; -0.0003158; -0.0004271; -0.0004843; -0.000662; -0.000801; -0.0009171; -0.001012; -0.001109; -0.001123],
  cnp=[0.001368; 0.001131; 0.0008953; 0.0006638; 0.000435; 0.0003212; 0.0002072; -1.934e-5; -0.0001334; -0.0002476; -0.0003622; -0.0004772; -0.0007092; -0.0008268; -0.001192; -0.001538; -0.001909; -0.002247; -0.002623; -0.002829],
  cnr=[-0.001047; -0.0009657; -0.000903; -0.000859; -0.000833; -0.0008264; -0.0008239; -0.00083; -0.0008383; -0.0008504; -0.0008667; -0.0008872; -0.000942; -0.0009765; -0.00111; -0.001222; -0.00132; -0.001404; -0.001465; -0.001472],
  clr=[-0.003927; -0.003193; -0.002462; -0.001742; -0.001039; -0.0006965; -0.0003606; 0.0002898; 0.0006182; 0.0009549; 0.001299; 0.00165; 0.00237; 0.002737; 0.003856; 0.004602; 0.005166; 0.005613; 0.005919; 0.005968],
  dcl_sym=[-0.048; -0.033; -0.016; 0; 0.016; 0.033; 0.042; 0.051],
  dcm_sym=[0.2748; 0.1878; 0.0939; -0.0002; -0.0939; -0.1878; -0.2417; -0.2897],
  dclmax_sym=[0.057; 0.041; 0.021; 0; 0.021; 0.041; 0.05; 0.06],
  dcdmin_sym=[0.0022; 0.0009; 0.00045; 0; 0.00045; 0.0009; 0.00168; 0.0025],
  clad_sym=repmat(NaN, 8, 1),
  cha_sym=[-0.003166; 99999; 99999; 99999; 99999; 99999; 99999; 99999],
  chd_sym=[-0.01248; -0.01242; -0.01242; -0.01242; -0.01242; -0.01242; -0.01244; -0.01251],
  dcdi_sym=[0.00815 0.00496 0.00216 -3.67e-6 -0.00151 -0.00238 -0.00259 -0.00259
   0.00719 0.0043 0.00183 -3.01e-6 -0.00119 -0.00173 -0.00175 -0.00158
   0.00626 0.00367 0.00151 -2.38e-6 -0.000869 -0.00109 -0.000931 -0.000605
   0.00534 0.00304 0.0012 -1.75e-6 -0.000554 -0.000464 -0.000118 0.000368
   0.00441 0.00241 0.000883 -1.12e-6 -0.000239 0.000166 0.000693 0.00134
   0.00395 0.00209 0.000725 -8.05e-7 -8.14e-5 0.000481 0.0011 0.00183
   0.00349 0.00178 0.000567 -4.89e-7 7.7e-5 0.000798 0.00151 0.00232
   0.00255 0.00114 0.000249 1.48e-7 0.000396 0.00144 0.00233 0.0033
   0.00209 0.000826 9.1e-5 4.63e-7 0.000553 0.00175 0.00274 0.00379
   0.00163 0.000515 -6.47e-5 7.75e-7 0.000709 0.00206 0.00314 0.00427
   0.00118 0.000203 -0.000221 1.09e-6 0.000865 0.00237 0.00354 0.00475
   0.000724 -0.000107 -0.000375 1.4e-6 0.00102 0.00268 0.00394 0.00523
   -0.000183 -0.000725 -0.000685 2.01e-6 0.00133 0.0033 0.00474 0.00619
   -0.000635 -0.00103 -0.000839 2.32e-6 0.00148 0.00361 0.00513 0.00666
   -0.002 -0.00197 -0.0013 3.25e-6 0.00195 0.00454 0.00633 0.0081
   -0.00294 -0.0026 -0.00162 3.89e-6 0.00227 0.00518 0.00716 0.00909
   -0.00394 -0.00329 -0.00197 4.58e-6 0.00261 0.00587 0.00804 0.0102
   -0.00511 -0.00408 -0.00236 5.37e-6 0.00301 0.00666 0.00906 0.0114
   -0.00635 -0.00493 -0.00279 6.22e-6 0.00343 0.00751 0.0102 0.0127
   -0.0077 -0.00586 -0.00325 7.14e-6 0.00389 0.00843 0.0113 0.0141])}

Variants = Simulink.VariantConfigurationData(
  struct(
    Configurations=[struct(
      Name="No_Secondary_HIL",
      Description="",
      ControlVariables=[struct(Name="SimType", Value=1, Source="data.sldd"), struct(Name="SecArd", Value=0, Source="data.sldd")]), struct(
      Name="With_Secondary_HIL",
      Description="",
      ControlVariables=[struct(Name="SimType", Value=1, Source="data.sldd"), struct(Name="SecArd", Value=1, Source="data.sldd")]), struct(
      Name="MIL",
      Description="",
      ControlVariables=[struct(Name="SimType", Value=0, Source="data.sldd"), struct(Name="SecArd", Value=0, Source="data.sldd")])],
    VariantConfigurations=[struct(
      Name="No_Secondary_HIL",
      Description="",
      ControlVariables=[struct(Name="SimType", Value="1", Source="data.sldd"), struct(Name="SecArd", Value="0", Source="data.sldd")],
      SubModelConfigurations=[]), struct(
      Name="With_Secondary_HIL",
      Description="",
      ControlVariables=[struct(Name="SimType", Value="1", Source="data.sldd"), struct(Name="SecArd", Value="1", Source="data.sldd")],
      SubModelConfigurations=[]), struct(
      Name="MIL",
      Description="",
      ControlVariables=[struct(Name="SimType", Value="0", Source="data.sldd"), struct(Name="SecArd", Value="0", Source="data.sldd")],
      SubModelConfigurations=[])],
    Constraints=[],
    PreferredConfiguration="",
    DefaultConfigurationName="MIL",
    DataDictionaryName="data.sldd",
    DataDictionarySection="",
    AreSubModelConfigurationsMigrated=true,
    ComponentConfigurationData=[],
    Version="24.1"))